vi "Function.gvi"   [LabVIEW NXG 5.0.0]
panel indicators:
  "Tree": cluster{"location": string, "data": string}[]
diagram:
  w1 = "{\"matrices\":[{\"name\":\"test\",\"baseName\":\"AoSubTest\",\"aid\":\"1\",\"columns\":[{\"name\":\"id\",\"baseName\":\"id\",\"dataType\":\"DT_LONGLONG\",\"longlongArray\":{\"values\":[\"11\"]}},{\"name\":\"name\",\"baseName\":\"name\",\"dataType\":\"DT_STRING\",\"stringArray\":{\"values\":[\"TR_M17_QT_42-2.TDM\"]}},{\"name\":\"testname\",\"dataType\":\"DT_STRING\",\"stringArray\":{\"values\":[\"TR_M17_QT_42-2\"]}},{\"name\":\"version\",\"baseName\":\"version\",\"dataType\":\"DT_STRING\",\"stringArray\":{\"values\":[\"11\"]}},{\"name\":\"description\",\"baseName\":\"description\",\"dataType\":\"DT_STRING\",\"stringArray\":{\"values\":[\"Production Data Module 17-M18-B4\"]}},{\"name\":\"title\",\"dataType\":\"DT_STRING\",\"stringArray\":{\"values\":[\"Example data set\"]}},{\"name\":\"author\",\"dataType\":\"DT_STRING\",\"stringArray\":{\"values\":[\"National Instruments\"]}},{\"name\":\"folder\",\"dataType\":\"DT_STRING\",\"stringArray\":{\"values\":[\"C:\\\\Users\\\\Public\\\\Documents\\\\National Instruments\\\\TDM Server Demo\\\\Processed_Data\"]}},{\"name\":\"datetime\",\"dataType\":\"DT_DATE\",\"stringArray\":{\"values\":[\"20190212071705000000000\"]}},{\"name\":\"createtime\",\"dataType\":\"DT_DATE\",\"stringArray\":{\"values\":[\"20200826144858000000000\"]}},{\"name\":\"modifytime\",\"dataType\":\"DT_DATE\",\"stringArray\":{\"values\":[\"20200826144858000000000\"]}},{\"name\":\"datapluginname\",\"dataType\":\"DT_STRING\",\"stringArray\":{\"values\":[\"TDM\"]}},{\"name\":\"composedsize\",\"dataType\":\"DT_LONGLONG\",\"longlongArray\":{\"values\":[\"92888\"]}},{\"name\":\"filesize\",\"dataType\":\"DT_LONGLONG\",\"longlongArray\":{\"values\":[\"52888\"]}},{\"name\":\"ni_workspace_id\",\"dataType\":\"DT_STRING\",\"stringArray\":{\"values\":[\"3f24c4dd-f232-4156-ae99-2adf04229755\"]}},{\"name\":\"parent_test\",\"baseName\":\"parent_test\",\"dataType\":\"DT_LONGLONG\",\"isNull\":[true],\"longlongArray\":{\"values\":[\"0\"]}}]}]}"
  Unflatten From Json(JSON string=w1, path=["matrices", "0", "columns", "2", "stringArray", "values"], type and defaults=string[] []) -> (value=w2)
  w3 = "{\"matrices\":[{\"name\":\"measurement\",\"baseName\":\"AoMeasurement\",\"aid\":\"2\",\"columns\":[{\"name\":\"id\",\"baseName\":\"id\",\"dataType\":\"DT_LONGLONG\",\"longlongArray\":{\"values\":[\"21\",\"22\"]}},{\"name\":\"name\",\"baseName\":\"name\",\"dataType\":\"DT_STRING\",\"stringArray\":{\"values\":[\"QT_42-2_Lower\",\"QT_42-2_Upper\"]}},{\"name\":\"version\",\"baseName\":\"version\",\"dataType\":\"DT_STRING\",\"stringArray\":{\"values\":[\"21\",\"22\"]}},{\"name\":\"description\",\"baseName\":\"description\",\"dataType\":\"DT_STRING\",\"stringArray\":{\"values\":[\"Lower sensor group\",\"Upper sensor group\"]}},{\"name\":\"test\",\"baseName\":\"test\",\"dataType\":\"DT_LONGLONG\",\"longlongArray\":{\"values\":[\"11\",\"11\"]}}]}]}"
  Unflatten From Json(JSON string=w3, path=["matrices", "0", "columns", "1", "stringArray", "values"], type and defaults=string[] []) -> (value=w4)
  w5 = "{\"matrices\":[{\"name\":\"measurementquantity\",\"baseName\":\"AoMeasurementQuantity\",\"aid\":\"3\",\"columns\":[{\"name\":\"id\",\"baseName\":\"id\",\"dataType\":\"DT_LONGLONG\",\"longlongArray\":{\"values\":[\"200\",\"202\",\"203\",\"204\",\"205\",\"206\",\"207\",\"208\",\"209\",\"210\"]}},{\"name\":\"name\",\"baseName\":\"name\",\"dataType\":\"DT_STRING\",\"stringArray\":{\"values\":[\"Temperature_A\",\"Temperature_B\",\"Temperature_C\",\"Temperature_D\",\"Temperature_E\",\"Temperature_F\",\"Temperature_G\",\"Temperature_H\",\"Temperature_I\",\"Temperature_J\"]}},{\"name\":\"version\",\"baseName\":\"version\",\"dataType\":\"DT_STRING\",\"stringArray\":{\"values\":[\"200\",\"202\",\"203\",\"204\",\"205\",\"206\",\"207\",\"208\",\"209\",\"210\"]}},{\"name\":\"description\",\"baseName\":\"description\",\"dataType\":\"DT_STRING\",\"stringArray\":{\"values\":[\"Position A\",\"Position B\",\"Position C\",\"Position D\",\"Position E\",\"Position F\",\"Position G\",\"Position H\",\"Position I\",\"Position J\"]}},{\"name\":\"unit_string\",\"dataType\":\"DT_STRING\",\"stringArray\":{\"values\":[\"°C\",\"°C\",\"°C\",\"°C\",\"°C\",\"°C\",\"°C\",\"°C\",\"°C\",\"°C\"]}},{\"name\":\"datatype\",\"baseName\":\"datatype\",\"dataType\":\"DT_ENUM\",\"longArray\":{\"values\":[7,7,7,7,7,7,7,7,7,7]}},{\"name\":\"minimum\",\"baseName\":\"minimum\",\"dataType\":\"DT_DOUBLE\",\"doubleArray\":{\"values\":[22.3447076500671,22.0945169379386,21.9687451519744,22.0687451519744,22.6473849914378,22.2473849914378,22.7473849914378,22.3447076500671,22.9129712999566,22.3473849914378]}},{\"name\":\"maximum\",\"baseName\":\"maximum\",\"dataType\":\"DT_DOUBLE\",\"doubleArray\":{\"values\":[33.3345175797737,37.1312719472808,32.9454258501354,34.8571711343737,47.9581315294204,36.7611799419855,53.5434863988634,31.2621904302284,35.7952307134241,29.7161696869656]}},{\"name\":\"measurement\",\"baseName\":\"measurement\",\"dataType\":\"DT_LONGLONG\",\"longlongArray\":{\"values\":[\"21\",\"21\",\"21\",\"21\",\"21\",\"21\",\"21\",\"21\",\"21\",\"21\"]}},{\"name\":\"unit\",\"baseName\":\"unit\",\"dataType\":\"DT_LONGLONG\",\"longlongArray\":{\"values\":[\"260\",\"260\",\"260\",\"260\",\"260\",\"260\",\"260\",\"260\",\"260\",\"260\"]}},{\"name\":\"quantity\",\"baseName\":\"quantity\",\"dataType\":\"DT_LONGLONG\",\"isNull\":[true,true,true,true,true,true,true,true,true,true],\"longlongArray\":{\"values\":[\"0\",\"0\",\"0\",\"0\",\"0\",\"0\",\"0\",\"0\",\"0\",\"0\"]}}]}]}"
  Unflatten From Json(JSON string=w5, path=["matrices", "0", "columns", "1", "stringArray", "values"], type and defaults=string[] []) -> (value=w6)
  Unflatten From Json(JSON string=w5, path=["matrices", "0", "columns", "4", "stringArray", "values"], type and defaults=string[] []) -> (value=w7)
  s1 = cluster{"location": string, "data": string}[] []  # shift register
  for {
    w8 = each element of w2
    s2 = s1  # shift register
    for {
      w9 = each element of w4
      s3 = s2  # shift register
      for {
        w10 = each element of w6
        w11 = each element of w7
        Format Into String(formatString="\\\\%s\\\\%s\\\\%s", w8, w9, w10) -> w12
        w13 = cluster{"location": string, "data": string} {all zero or empty}
        Property Node(instance in=w13, "location"=w12, "data"=w11) -> (instance out=w14)
        Build Array(s3, w14) -> w15
        next s3 = w15
      }
      next s2 = s3
    }
    next s1 = s2
  }
  $Tree <- s1
