vi "Function_2.gvi"   [LabVIEW NXG 5.0.0]
panel controls:
  "id_input": string
  "Command_Template": string
  "client handle": "Client Handle.gtype"
panel indicators:
  "client handle out": "Client Handle.gtype"
  "Graph": f64[]
types:
  "Client Handle.gtype" = u32
uses:
  NI::G Core::Strings::Search and Replace Pattern.gvi
  NI::HTTP::POST Buffer.gvi
diagram:
  # TR_M17_QT_42-2.tdm
  call "Search and Replace Pattern.gvi"(string=$Command_Template, pattern="@@", replace string=$id_input) -> (result string=w1)
  call "POST Buffer.gvi"(client handle=$"client handle", buffer=w1) -> (client handle out=w2, body=w3)
  $"client handle out" <- w2
  w4 = ["matrices", "0", "columns", "2", "unknownArrays", "values", "0", "doubleArray", "values"]
  Unflatten From Json(JSON string=w3, path=w4, type and defaults=f64[] []) -> (value=w5)
  $Graph <- w5
