vi "Function.gviweb"   [LabVIEW NXG 5.0.0]
panel indicators:
  "body": string
  "headers": string
  "error out": error
  "status code": u32
uses:
  NI::Skyline::Configuration::Open Configuration.gvi
  NI::HTTP::Add Header.gvi
  NI::HTTP::POST Buffer.gvi
  NI::HTTP::Close HTTP Handle.gvi
diagram:
  w1 = "{\"variables\":{\"$URL\":{\"stringArray\":{\"values\":[\"corbaname::#ProcessedDataIndex.ASAM-ODS\"]}}}}"
  call "Open Configuration.gvi"(server url="http://localhost:9090", username="admin", password="admin") -> (configuration=w2, error out=w3)
  Property Node(instance in=w2) -> ("Session"=w4)
  w5 = ["application/x-asamods+json", "application/x-asamods+json", "Basic YWRtaW46YWRtaW4="]
  s1 = w4  # shift register
  for {
    w6 = each element of ["Content-Type", "Accept", "Authorization"]
    w7 = each element of w5
    call "Add Header.gvi"(client handle=s1, header=w6, value=w7, error in=w3) -> (client handle out=w8, error out=w9)
    next s1 = w8
  }
  call "POST Buffer.gvi"(client handle=s1, url="http://localhost:9090/ni/asam/ods", buffer=w1, error in=w9) -> (status code=w10, client handle out=w11, headers=w12, body=w13, error out=w14)
  $headers <- w12
  $body <- w13
  call "Close HTTP Handle.gvi"(client handle=w11, error in=w14) -> (error out=w15)
  $"error out" <- w15
  $"status code" <- w10
