vi "Main_CallTaskFromWebVI.gviweb"   [LabVIEW NXG 5.0.0]
panel controls:
  "fire_analysis_task": bool
  "Button_2": bool
  "Parameter Task 1": T1
  "Parameter Task 2": cluster{"Numeric_3": f64, "Power Button": bool}
  "Files List": i32 = -1
  "Analysis List": i32
  "Button_3": bool
panel indicators:
  "Current Task Status": string
  "Comapny Logo": string
  "Channel Data": f64[]
  "TDM File Structure": cluster{"location": string, "data": string}[]
types:
  T1 = cluster{"Numeric": f64, "Numeric_2": f64, "Numeric_3": f64}
  "Client Handle.gtype" = u32
  "Message Session.gtype" = cluster{"Configuration": "Configuration.gtype", "token": string}
  T2 = cluster{"ClientHandle": "Client Handle.gtype", "MessageSession": "Message Session.gtype", "Server URL": string, "names": string[], "IDs": string[]}
uses:
  WebApp::subVIs::Disable_Controls.gviweb
  NI::Skyline::Configuration::Open Configuration.gvi
  NI::Skyline::MessageHTTP::Open.gvi
  WebApp::subVIs::Execute Task.gviweb
  WebApp::subVIs::Get_Tasks.gviweb
  WebApp::subVIs::Get_Indexed_Files.gviweb
  WebApp::subVIs::Retrieve_File_Info.gviweb
  NI::Skyline::MessageHTTP::Subscribe.gvi
  NI::Skyline::MessageHTTP::Read.gvi
diagram:
  w1 = "Initialize"  # States
  s1 = uninitialised  # shift register
  s2 = w1  # shift register
  s3 = T2 {all zero or empty}  # shift register
  while {
    # w2: > App Data >
    # w3: > Next State >
    # w4: > Error >
    case (s2) {
      frame "Initialize" {
        w6 = "Connecto to SystemLink"  # States
        disable {
          frame Enabled {
            w4 = default
          }
          frame Disabled {
            Build Array(reference to "Parameter Task 1", reference to "fire_analysis_task") -> w7
            call "Disable_Controls.gviweb"(Control Reference=w7, Disabled=FALSE) -> (error out=w8)
            Build Array(reference to "Parameter Task 2", reference to "Button_2") -> w9
            call "Disable_Controls.gviweb"(Control Reference=w9, Disabled=TRUE, error in=w8) -> (error out=w4)
          }
        }
        w3 = w6
        w2 = s3
        w5 = "Initializing..."
      }
      frame "Connecto to SystemLink" {
        call "Open Configuration.gvi"(server url="http://localhost", username="lvadmin", password="LabVIEW===") -> (configuration=w10, error out=w11)
        Property Node(instance in=w10) -> ("Session"=w12, "Server URL"=w13)
        call "Open.gvi"(error in=w11, configuration=w10) -> (message session=w14, error out=w4)
        Property Node(instance in=s3, "ClientHandle"=w12, "Server URL"=w13, "MessageSession"=w14) -> (instance out=w2)
        w15 = "Fire Task"  # States
        w3 = w15
        w5 = "Getting data from the server..."
      }
      frame "Fire Task", Default {
        event (timeout = 5000) {
          on "fire_analysis_task" Value changed {
            Property Node(instance in=s3) -> ("ClientHandle"=w16, "Server URL"=w17, "IDs"=w18, instance out=w2)
            Array Index(array=w18) -> (out0[$"Analysis List"]=w19)
            call "Execute Task.gviweb"(client handle out_2=w16, Server URL out=w17, paths=string[] [], task id=w19)
            w3 = "Wait for Task to Complete"
            w5 = "Analysis task fired!"
          }
          on "Timeout" {
            Property Node(instance in=s3) -> ("ClientHandle"=w20, instance out=w21)
            call "Get_Tasks.gviweb"(client handle=w20) -> (names=w22, IDs=w23)
            call "Get_Indexed_Files.gviweb"(client handle=w20) -> (Files List=w24)
            Property Node(instance in=w21, "IDs"=w23, "names"=w24) -> (instance out=w2)
            Property Node(instance in=reference to "Analysis List", "Items"=w22)
            Property Node(instance in=reference to "Files List", "Items"=w24)
            w25 = "Select a task from the Analysis List box and then click the \"Fire Analysis Task\" button. You can also Select one of the TDM files listed to retrieve their TDM structure and see one of their channel data plotted."
            w3 = "Fire Task"
            w5 = w25
          }
          on "Button_3" Value changed {
            Property Node(instance in=s3) -> ("ClientHandle"=w26, "names"=w27, instance out=w2)
            Array Index(array=w27) -> (out0[$"Files List"]=w28)
            call "Retrieve_File_Info.gviweb"(Client Session In=w26, TDM_File_Name=w28) -> (Graph=w29, Tree=w30)
            $"Channel Data" <- w29
            $"TDM File Structure" <- w30
            w3 = "Fire Task"
            w5 = "TDM File Loaded!"
          }
        }
        w4 = s1
      }
      frame "Wait for Task to Complete" {
        sequence {
          frame 0 {
            Wait(time to wait=7000)
            $"Current Task Status" <- "Waiting for Task to Complete..."
          }
        }
        Property Node(instance in=s3) -> ("MessageSession"=w31, "Server URL"=w32, instance out=w2)
        call "Subscribe.gvi"(message session in=w31, topic=w32, error in=s1) -> (message session out=w33, error out=w34)
        call "Read.gvi"(message session in=w33, timeout=10000, error in=w34) -> (dequeue status=w35, message=w36, error out=w37)
        case (w35) {
          frame True {
            w38 = "Wait for Task to Complete"  # States
            w5 = "Waiting for Task to Complete..."
            w3 = w38
            w4 = w37
          }
          frame False {
            w39 = "Fire Task"  # States
            w40 = "Task finished! Choose a task and then hit the \"Fire task!\" button"
            $"Current Task Status" <- w36
            w5 = w40
            w3 = w39
            w4 = w37
          }
        }
      }
    }
    $"Current Task Status" <- w5
    next s1 = w4
    next s2 = w3
    next s3 = w2
    stop if FALSE
  }
