vi "Execute Task.gviweb"   [LabVIEW NXG 5.0.0]
inputs:
  "configuration": "Configuration.gtype"
  "Server URL out": string
  "paths": string[]
  "task id": string = "a5e96044-3d80-4761-8ea5-70aba0bef7f3"
outputs:
  "Output": string[]
  "concatenated string": string
  "headers": string
  "body": string
types:
  "Client Handle.gtype" = u32
  "Configuration.gtype" = cluster{"Server URL": string, "Session": "Client Handle.gtype", "Raw Session Queue": Queue<"Client Handle.gtype">}
uses:
  NI::HTTP::POST Buffer.gvi
diagram:
  Property Node(instance in=$configuration) -> ("Session"=w1)
  # Data Analysis Service
  # /nidataanalyzer/v1/executions
  Concatenate Strings($"Server URL out", "/nidataanalyzer/v1/executions") -> w2
  Concatenate Strings("{\n  \"tasks\": [\n    {\n      \"taskId\": \"", $"task id", "\",\n      \"parameters\": [", "]}]}") -> w3
  call "POST Buffer.gvi"(client handle=w1, url=w2, buffer=w3) -> (headers=w4, body=w5)
  $headers <- w4
  $body <- w5
  $"concatenated string" <- w3
