vi "Get_Channel_Data.gviweb"   [LabVIEW NXG 5.0.0]
inputs:
  "client handle": "Client Handle.gtype"
  "url": string
  "Command_Template": string
  "id_input": string
outputs:
  "client handle out": "Client Handle.gtype"
  "Graph": f64[]
  "error out": error
  "body": string
types:
  "Client Handle.gtype" = u32
uses:
  NI::G Core::Strings::Search and Replace Pattern.gvi
  NI::HTTP::POST Buffer.gvi
diagram:
  call "Search and Replace Pattern.gvi"(string=$Command_Template, pattern="@@", replace string=$id_input) -> (result string=w1)
  call "POST Buffer.gvi"(client handle=$"client handle", url=$url, buffer=w1) -> (client handle out=w2, body=w3)
  $"client handle out" <- w2
  $body <- w3
  w4 = ["matrices", "0", "columns", "2", "unknownArrays", "values", "0", "doubleArray", "values"]
  Unflatten From Json(JSON string=w3, path=w4, type and defaults=f64[] []) -> (error out=w5, value=w6)
  $Graph <- w6
  $"error out" <- w5
