vi "Get_Channel_Reference.gviweb"   [LabVIEW NXG 5.0.0]
inputs:
  "client handle": "Client Handle.gtype"
  "url": string
  "Command_Template": string
  "id_input": string
outputs:
  "id_out": string
  "client handle out": "Client Handle.gtype"
  "error out": error
  "body": string
types:
  "Client Handle.gtype" = u32
uses:
  NI::G Core::Strings::Search and Replace Pattern.gvi
  NI::HTTP::POST Buffer.gvi
diagram:
  call "Search and Replace Pattern.gvi"(string=$Command_Template, pattern="@@", replace string=$id_input) -> (result string=w1)
  # This SubVI traverses the file hierarchy until it gets to the channel reference.
  call "POST Buffer.gvi"(client handle=$"client handle", url=$url, buffer=w1) -> (client handle out=w2, body=w3)
  $"client handle out" <- w2
  $body <- w3
  Unflatten From Json(JSON string=w3, path=["matrices", "0", "columns", "0", "longlongArray", "values"], type and defaults=string[] []) -> (error out=w4, value=w5)
  Array Index(array=w5) -> (out0[_]=w6)
  $id_out <- w6
  $"error out" <- w4
