vi "Get_Indexed_Files.gviweb"   [LabVIEW NXG 5.0.0]
inputs:
  "configuration": "Configuration.gtype"
  "error in": error
outputs:
  "error out": error
  "Files List": string[]
  "body": string
types:
  "Client Handle.gtype" = u32
  "Configuration.gtype" = cluster{"Server URL": string, "Session": "Client Handle.gtype", "Raw Session Queue": Queue<"Client Handle.gtype">}
  T1 = cluster{"type": string, "elemid": i32, "name": string, "fileid": i32, "indexstatus": string, "indexingduration": i32, "errorlog": string, "modifytimeatindexing": string, "composedsize": i32, "dataplugintype": string}
  T2 = cluster{"type": string, "elemid": i32, "name": string, "dirid": i32, "path": string, "createdate": string, "modifydate": string, "filesize": i32, "readonly": bool, "offline": bool, "encrypted": bool, "compressed": bool, "dataplugins": T1[]}
uses:
  NI::HTTP::Add Header.gvi
  NI::HTTP::GET.gvi
diagram:
  Property Node(instance in=$configuration) -> ("Server URL"=w1, "Session"=w2)
  call "Add Header.gvi"(client handle=w2, header="Accept-Language", value="application/json", error in=$"error in") -> (client handle out=w3, error out=w4)
  w5 = "/TDMServer_dfse/datafinders/2bb02b7b-aef6-4a9b-b1bf-3f66ac12fcd6/data?folder_id=3&include_dataplugins=true"
  # DataFinder Configuration
  Concatenate Strings(w1, w5) -> w6
  call "GET.gvi"(client handle=w3, url=w6, error in=w4) -> (body=w7, error out=w8)
  $body <- w7
  Unflatten From Json(JSON string=w7, default null elements=FALSE, type and defaults=cluster{"files": T2[]} {all zero or empty}) -> (error out=w9, value=w10)
  Merge Errors(w8, w9) -> (error out=w11)
  $"error out" <- w11
  Property Node(instance in=w10) -> ("files"=w12)
  for {
    w13 = each element of w12
    Property Node(instance in=w13) -> ("path"=w15)
    Match Pattern(regular expression="[^\\\\/:*?\"<>|\\r\\n]+$", string=w15) -> (match substring=w16)
    append w16 to w14
  }
  $"Files List" <- w14
