vi "Get_Tasks.gviweb"   [LabVIEW NXG 5.0.0]
inputs:
  "configuration": "Configuration.gtype"
  "Error In": error
outputs:
  "names": string[]
  "IDs": string[]
  "Error Out": error
  "body": string
types:
  "Client Handle.gtype" = u32
  "Configuration.gtype" = cluster{"Server URL": string, "Session": "Client Handle.gtype", "Raw Session Queue": Queue<"Client Handle.gtype">}
  T1 = cluster{"name": string, "type": string, "value": string, "description": string}
  T2 = cluster{"taskId": string, "name": string, "parameters": T1[]}
  T3 = cluster{"_links": cluster{"self": cluster{"href": string}}, "tasks": T2[]}
uses:
  NI::HTTP::Add Header.gvi
  NI::HTTP::GET.gvi
diagram:
  Property Node(instance in=$configuration) -> ("Server URL"=w1, "Session"=w2)
  call "Add Header.gvi"(client handle=w2, header="Accept-Language", value="application/json", error in=$"Error In") -> (client handle out=w3, error out=w4)
  Concatenate Strings(w1, "/nidataanalyzer/v1/tasks?expand=taskId%3Bname%3Bparameters") -> w5
  call "GET.gvi"(client handle=w3, url=w5, error in=w4) -> (body=w6, error out=w7)
  # Data Analysis Service
  # Get the list of tasks names and ID
  $body <- w6
  # JSON String based on the Data Analysis Service HTTP API
  Unflatten From Json(JSON string=w6, type and defaults=T3 {all zero or empty}) -> (error out=w8, value=w9)
  Merge Errors(w7, w8) -> (error out=w10)
  $"Error Out" <- w10
  Property Node(instance in=w9) -> ("tasks"=w11)
  for {
    w12 = each element of w11
    Property Node(instance in=w12) -> ("name"=w15, "taskId"=w16)
    append w15 to w13
    append w16 to w14
  }
  $names <- w13
  $IDs <- w14
