vi "Populate_TDM_Tree.gviweb"   [LabVIEW NXG 5.0.0]
inputs:
  "FileLevel": string[]
  "Channel Group": string[]
  "Channel": string[]
  "Channel_Unit": string[]
outputs:
  "Output": cluster{"location": string, "data": string}[]
diagram:
  s1 = cluster{"location": string, "data": string}[] []  # shift register
  for {
    w1 = each element of $FileLevel
    # File Level
    s2 = s1  # shift register
    for {
      w2 = each element of $"Channel Group"
      # Group Level
      s3 = s2  # shift register
      for {
        w3 = each element of $Channel
        w4 = each element of $Channel_Unit
        Format Into String(formatString="\\\\%s\\\\%s\\\\%s", w1, w2, w3) -> w5
        w6 = cluster{"location": string, "data": string} {all zero or empty}
        # Channel Level
        Property Node(instance in=w6, "location"=w5, "data"=w4) -> (instance out=w7)
        Build Array(s3, w7) -> w8
        next s3 = w8
      }
      next s2 = s3
    }
    next s1 = s2
  }
  $Output <- s1
