vi "Retrieve_File_Info.gviweb"   [LabVIEW NXG 5.0.0]
inputs:
  "error in": error
  "configuration": "Configuration.gtype"
  "TDM_File_Name": string = "TR_M17_QT_42-4.tdm"
outputs:
  "error out": error
  "Graph": f64[]
  "Tree": cluster{"location": string, "data": string}[]
  "headers": string
types:
  "Client Handle.gtype" = u32
  "Configuration.gtype" = cluster{"Server URL": string, "Session": "Client Handle.gtype", "Raw Session Queue": Queue<"Client Handle.gtype">}
uses:
  NI::HTTP::Add Header.gvi
  NI::HTTP::POST Buffer.gvi
  WebApp::subVIs::Get_Channel_Reference.gviweb
  WebApp::subVIs::Get_Channel_Data.gviweb
  WebApp::subVIs::Populate_TDM_Tree.gviweb
diagram:
  Property Node(instance in=$configuration) -> ("Server URL"=w1, "Session"=w2)
  w3 = ["Basic bHZhZG1pbjpMYWJWSUVXPT09", "application/x-asamods+json", "application/x-asamods+json"]
  # Data Navigator Data Service
  s1 = w2  # shift register
  for {
    w4 = each element of ["Authorization", "Content-Type", "Accept"]
    w5 = each element of w3
    call "Add Header.gvi"(client handle=s1, header=w4, value=w5, error in=$"error in") -> (client handle out=w6, error out=w7)
    next s1 = w6
  }
  w8 = "{\"variables\":{\"$URL\":{\"stringArray\":{\"values\":[\"corbaname::#Demo_Temperature_Data.ASAM-ODS\"]}}}}"
  Concatenate Strings(w1, "/ni/asam/ods") -> w9
  call "POST Buffer.gvi"(client handle=s1, url=w9, buffer=w8, error in=w7) -> (client handle out=w10, headers=w11, error out=w12)
  $headers <- w11
  Search Or Split String(search string/char="location: ", string=w11) -> (match + rest of string=w13)
  Pick Line(line index=0, multi-line string=w13) -> (output string=w14)
  String Length(string="location: ") -> (length=w15)
  String Subset(offset (0)=w15, string=w14) -> w16
  Concatenate Strings(w16, "/ni/data-read") -> w17
  s2 = w10  # shift register
  for {
    w18 = each element of ["Authorization", "Content-Type"]
    w19 = each element of ["Basic bHZhZG1pbjpMYWJWSUVXPT09", "application/json"]
    call "Add Header.gvi"(client handle=s2, header=w18, value=w19, error in=w12) -> (client handle out=w20, error out=w21)
    next s2 = w20
  }
  w22 = "{\"test\":{\"name\":\"@@\"},\"$options\":{\"$rowlimit\":1}}"
  call "Get_Channel_Reference.gviweb"(client handle=s2, Command_Template=w22, id_input=$TDM_File_Name, url=w17) -> (body=w23, client handle out=w24, id_out=w25)
  call "Get_Channel_Reference.gviweb"(client handle=w24, Command_Template="{\"measurement\":{\"test\":@@}}", id_input=w25, url=w17) -> (body=w26, client handle out=w27, id_out=w28)
  call "Get_Channel_Reference.gviweb"(client handle=w27, Command_Template="{\"measurementquantity\":{\"measurement\":@@}}", id_input=w28, url=w17) -> (body=w29, client handle out=w30, id_out=w31)
  w32 = "{\n  \"localcolumn\": {\n    \"measurement_quantity\": @@\n  }\n}"
  call "Get_Channel_Reference.gviweb"(client handle=w30, Command_Template=w32, id_input=w31, url=w17) -> (client handle out=w33, id_out=w34)
  w35 = "{\"localcolumn\":@@,\"$attributes\":{\"id\":1,\"values\":1,\"flags\":1},\"$options\":{\"$valskip\":0,\"$vallimit\":250}}"
  call "Get_Channel_Data.gviweb"(client handle=w33, Command_Template=w35, id_input=w34, url=w17) -> (Graph=w36, error out=w37)
  $Graph <- w36
  $"error out" <- w37
  Unflatten From Json(JSON string=w23, path=["matrices", "0", "columns", "2", "stringArray", "values"], type and defaults=string[] []) -> (value=w38)
  Unflatten From Json(JSON string=w26, path=["matrices", "0", "columns", "1", "stringArray", "values"], type and defaults=string[] []) -> (value=w39)
  Unflatten From Json(JSON string=w29, path=["matrices", "0", "columns", "1", "stringArray", "values"], type and defaults=string[] []) -> (value=w40)
  Unflatten From Json(JSON string=w29, path=["matrices", "0", "columns", "4", "stringArray", "values"], type and defaults=string[] []) -> (value=w41)
  call "Populate_TDM_Tree.gviweb"(Channel_Unit=w41, Channel=w40, Channel Group=w39, FileLevel=w38) -> (Output=w42)
  $Tree <- w42
